# Grasshopper definition MPDA_HNP.gh (Grasshopper 1.0.8)

read_file = ReadFile(File="C:\Users\usuari\Documents\GitHub\MPDA_HNP\MPDA_HNP.py", PerLineParse=False)
python_3_script = Python3Script(
    script=read_file,
    amp_h=Slider(7, range=0..50),
    amp_v=Slider(14, range=0..50),
    freq_h=Slider(31.126, range=0..50),
    freq_v=Slider(7.699, range=0..10),
    div_u=Slider(5.65, range=0..10),
    div_v=Slider(4.59, range=0..100),
    width=Slider(32, range=0..50),
    length=Slider(50, range=0..50),
    height=Slider(14, range=0..50))  # -> out, surface, mesh, points, strips_u, strips_v; unedited script template
srf = Surface(python_3_script.surface)
panel = Panel(python_3_script.surface)
mesh = Mesh(python_3_script.mesh)
crv = Curve(python_3_script.strips_u)
crv_2 = Curve(python_3_script.strips_v)
read_file_2 = ReadFile(File="C:\Users\usuari\Documents\GitHub\MPDA_HNP\MPDA_NHP.py", PerLineParse=False)
pt = Point(python_3_script.points)
read_file_3 = ReadFile(File="C:\Users\usuari\Documents\GitHub\MPDA_HNP\MPDA_PNH.py", PerLineParse=False)
python_3_script_2 = Python3Script(script=read_file_2, y=pt)  # -> out, a; unedited script template
python_3_script_3 = Python3Script(script=read_file_3, y=crv, z=crv_2)  # -> out, a; unedited script template
