# Grasshopper definition MPDA_HNP_Final.gh (Grasshopper 1.0.8)

read_file = ReadFile(File="C:\MPDA\Session03\MPDA_HNP\MPDA_surface.py", PerLineParse=False)
pt = ConstructPoint(XCoordinate=Slider(67, range=0..200), YCoordinate=Slider(129, range=0..200), ZCoordinate=0)
python_3_script = Python3Script(
    script=read_file,
    amp_h=Slider(11, range=0..20),
    amp_v=Slider(1, range=0..10),
    freq_h=Slider(3, range=0..10),
    freq_v=Slider(1, range=0..10),
    div_u=Slider(7, range=0..50),
    div_v=Slider(14, range=0..50),
    width=Slider(200, range=0..200),
    length=Slider(200, range=0..200),
    height=Slider(20, range=0..50),
    drop_height=Slider(118, range=0..200),
    drop_part_ratio=Slider(0.5, range=0..1),
    drop_location=pt)  # -> mesh, points, strips_u, strips_v; inputs drop_height: Int32, drop_location: Point3d; unedited script template
panel = Panel(python_3_script.strips_v)
panel_2 = Panel(python_3_script.strips_u)
mesh = Mesh(python_3_script.mesh)
crv = Curve(python_3_script.strips_u)
crv_2 = Curve(python_3_script.strips_v)
pt_2 = Point(python_3_script.points)
pt_3 = Point(python_3_script.points)
pline = PolyLine(Vertices=pt_3, Closed=False)
polygon = Polygon(Plane=crv, Radius=3, Segments=6, FilletRadius=0)  # -> Polygon, Length
points = PointList(Points=pt_2, Size=Slider(0.937, range=0..1))
panel_3 = Panel("C:\MPDA\Session03\MPDA_HNP\MPDA_Beam.py")  # disabled
number_slider = Slider(32, range=0..50)  # disabled
number_slider_2 = Slider(32, range=0..50)  # disabled
number_slider_3 = Slider(32, range=0..50)  # disabled
item = ListItem(List=pt_2, Index=Slider(60, range=0..120), Wrap=True)
number_slider_4 = Slider(32, range=0..50)  # disabled
read_file_2 = ReadFile(File=panel_3, PerLineParse=False)  # disabled
read_file_3 = ReadFile(File="C:\MPDA\Session03\MPDA_HNP\MPDA_Points.py", PerLineParse=False)
pt_4 = Point(item)
python_3_script_2 = Python3Script(
    script_A=read_file_2,
    strips_u=crv,
    strips_v=crv_2,
    width=number_slider,
    height=number_slider_2,
    twist_deg=number_slider_3,
    sections=number_slider_4)  # -> breps, frames, profiles; disabled; unedited script template
python_3_script_3 = Python3Script(script=read_file_3, Point=pt_4, Height=Slider(10, range=0..10))  # -> Mesh; inputs Point: Point3d; unedited script template
pipe = Pipe(Radius=1, Caps=0, FitRail=False)  # disabled
mesh_2 = Mesh(python_3_script_3)
panel_4 = Panel(python_3_script_2.profiles)  # disabled
panel_5 = Panel(python_3_script_3)
rec = Rectangle(python_3_script_2.profiles)  # disabled
